# Dynamo custom node Get Rhino Object Keys.dyf (Dynamo 0.7.6.4145)
# category: Archi-lab_MantisShrimp.Rhinoceros.Properties
# This node will extract all "keys" from the User Strings key/value combination. Use this node in combination with Get Rhino Object User Strings to get user string values.

Rhino_Object_s = Input()  # "Rhino Object(s)"
python_script = Python(IN[0]=Rhino_Object_s)
# ---------- python_script.python (39 lines) ----------
#Copyright(c) 2015, Konrad Sobon
# @arch_laboratory, http://archi-lab.net

import clr
import sys
clr.AddReference('ProtoGeometry')

pyt_path = r'C:\Program Files (x86)\IronPython 2.7\Lib'
sys.path.append(pyt_path)

import os
appDataPath = os.getenv('APPDATA')
msPath = appDataPath + r"\Dynamo\0.7\packages\Mantis Shrimp\extra"
rhPath = appDataPath + r"\Dynamo\0.7\packages\Mantis Shrimp\bin"
rhDllPath = appDataPath + r"\Dynamo\0.7\packages\Mantis Shrimp\bin\RhinoCommon.dll"
if msPath not in sys.path:
	sys.path.Add(msPath)
if rhPath not in sys.path:
	sys.path.Add(rhPath)
	clr.AddReferenceToFileAndPath(rhDllPath)

from Autodesk.DesignScript.Geometry import *
import Rhino as rc

#The inputs to this node will be stored as a list in the IN variable.
dataEnteringNode = IN
rhObjects = IN[0]

#convert rhino/gh geometry to ds geometry
userStringKeys = []
for item in rhObjects:
	try:
		item = item.Geometry
	except:
		pass
	userStringKeys.append(item.GetUserStrings().Keys)

#Assign your output to the OUT variable
OUT = userStringKeys
# ----------------------------------------
Keys = Output(python_script)
