# Dynamo custom node Get Rhino Object User Strings.dyf (Dynamo 0.7.6.4145)
# category: Archi-lab_MantisShrimp.Rhinoceros.Properties
# This node will query user strings attached to geometry.

Rhino_Object_s = Input()  # "Rhino Object(s)"
Keys = Input()
python_script = Python(IN[0]=Rhino_Object_s, IN[1]=Keys)
# ---------- python_script.python (46 lines) ----------
#Copyright(c) 2015, Konrad Sobon
# @arch_laboratory, http://archi-lab.net

import clr
import sys
clr.AddReference('ProtoGeometry')

pyt_path = r'C:\Program Files (x86)\IronPython 2.7\Lib'
sys.path.append(pyt_path)

import os
appDataPath = os.getenv('APPDATA')
msPath = appDataPath + r"\Dynamo\0.7\packages\Mantis Shrimp\extra"
rhPath = appDataPath + r"\Dynamo\0.7\packages\Mantis Shrimp\bin"
rhDllPath = appDataPath + r"\Dynamo\0.7\packages\Mantis Shrimp\bin\RhinoCommon.dll"
if msPath not in sys.path:
	sys.path.Add(msPath)
if rhPath not in sys.path:
	sys.path.Add(rhPath)
	clr.AddReferenceToFileAndPath(rhDllPath)

from Autodesk.DesignScript.Geometry import *
import Rhino as rc

#The inputs to this node will be stored as a list in the IN variable.
dataEnteringNode = IN
rhObjects = IN[0]
keys = IN[1]

#extract all user strings from rhino object
try:
	item = item.Geometry
except:
	pass
if not any(isinstance(item, list) for item in keys):
	userStrings = []
	for key in keys[index]:
		userStrings[index].extend(item.GetUserStrings().GetValues(key))
else:
	userStrings = [[] for i in range(len(rhObjects))]
	for index, item in enumerate(rhObjects):
		for key in keys[index]:
			userStrings[index].extend(item.GetUserStrings().GetValues(key))

#Assign your output to the OUT variable
OUT = userStrings
# ----------------------------------------
User_Strings = Output(python_script)
