# Dynamo custom node RH NurbsCurve to DS NurbsCurve.dyf (Dynamo 0.7.6.4145)
# category: Archi-lab_MantisShrimp.Rhinoceros.Geometry
# Converts Rhino Nurbs Curves to Design Script Nurbs Curves. Keep in mind that within OpenNURBS library Ellipses are defined as a NurbsCurve so it will also be passed by this node.

Rhino_Object_s = Input()  # "Rhino Object(s)"
Units = Input()
python_script = Python(IN[0]=Rhino_Object_s, IN[1]=Units)
# ---------- python_script.python (96 lines) ----------
#Copyright(c) 2015, Konrad Sobon
# @arch_laboratory, http://archi-lab.net

import clr
import sys
clr.AddReference('ProtoGeometry')

pyt_path = r'C:\Program Files (x86)\IronPython 2.7\Lib'
sys.path.append(pyt_path)

import os
appDataPath = os.getenv('APPDATA')
msPath = appDataPath + r"\Dynamo\0.7\packages\Mantis Shrimp\extra"
rhPath = appDataPath + r"\Dynamo\0.7\packages\Mantis Shrimp\bin"
rhDllPath = appDataPath + r"\Dynamo\0.7\packages\Mantis Shrimp\bin\RhinoCommon.dll"
if msPath not in sys.path:
	sys.path.Add(msPath)
if rhPath not in sys.path:
	sys.path.Add(rhPath)
	clr.AddReferenceToFileAndPath(rhDllPath)

from Autodesk.DesignScript.Geometry import *
import Rhino as rc
from System import Array
from System.Collections.Generic import *

#The inputs to this node will be stored as a list in the IN variable.
dataEnteringNode = IN
rhObjects = IN[0]
_units = IN[1]

#unit conversion function from Rhino to DS
def toDSUnits(_units):
	if _units == rc.UnitSystem.Millimeters:
		return 0.001
	elif _units == rc.UnitSystem.Centimeters:
		return 0.01
	elif _units == rc.UnitSystem.Decimeters:
		return 0.1
	elif _units == rc.UnitSystem.Meters:
		return 1
	elif _units == rc.UnitSystem.Inches:
		return 0.0254
	elif _units == rc.UnitSystem.Feet:
		return 0.3048
	elif _units == rc.UnitSystem.Yards:
		return 0.9144

#point/control point conversion function
def rhPointToPoint(rhPoint):
	rhPointX = rhPoint.Location.X * toDSUnits(_units)
	rhPointY = rhPoint.Location.Y * toDSUnits(_units)
	rhPointZ = rhPoint.Location.Z * toDSUnits(_units)
	return Point.ByCoordinates(rhPointX, rhPointY, rhPointZ)

#single span nurbs curve conversion function
def rhSingleSpanNurbsCurveToCurve(rhCurve):		
	#get control points
	ptArray, weights, knots = [], [], []
	rhControlPoints = rhCurve.Points
	for rhPoint in rhControlPoints:
		dsPoint = rhPointToPoint(rhPoint)
		ptArray.append(dsPoint)
		#get weights for each point
		weights.append(rhPoint.Weight)
	#convert Python list to IEnumerable[]
	ptArray = List[Point](ptArray)
	weights = Array[float](weights)
	#get degree of the curve
	degree = rhCurve.Degree
	#get knots of the curve
	rhKnots = rhCurve.Knots
	for i in rhKnots:
		knots.append(i)
	knots.insert(0, knots[0])
	knots.insert(len(knots), knots[(len(knots)-1)])
	knots = Array[float](knots)
	#create ds curve from points, weights and knots
	dsNurbsCurve = NurbsCurve.ByControlPointsWeightsKnots(ptArray, weights, knots, degree)
	ptArray.Clear()
	Array.Clear(weights, 0, len(weights))
	Array.Clear(knots, 0, len(knots))
	return dsNurbsCurve

#convert rhino/gh geometry to ds geometry
dsNurbsCurves = []
for i in rhObjects:
	try:
		i = i.Geometry
	except:
		pass
	if i.ToString() == "Rhino.Geometry.NurbsCurve":
		dsNurbsCurves.append(rhSingleSpanNurbsCurveToCurve(i))

#Assign your output to the OUT variable
OUT = dsNurbsCurves
# ----------------------------------------
NurbsCurve_s = Output(python_script)  # "NurbsCurve(s)"
