# Dynamo custom node RH PolyCurve to DS PolyCurve .dyf "RH PolyCurve to DS PolyCurve" (Dynamo 0.7.6.4145)
# category: Archi-lab_MantisShrimp.Rhinoceros.Geometry
# Converts Rhino polycurves to Design Script Polycurves.

Rhino_Object_s = Input()  # "Rhino Object(s)"
Units = Input()
python_script = Python(IN[0]=Rhino_Object_s, IN[1]=Units)
# ---------- python_script.python (202 lines) ----------
#Copyright(c) 2015, Konrad Sobon
# @arch_laboratory, http://archi-lab.net

import clr
import sys
clr.AddReference('ProtoGeometry')

pyt_path = r'C:\Program Files (x86)\IronPython 2.7\Lib'
sys.path.append(pyt_path)

import os
appDataPath = os.getenv('APPDATA')
msPath = appDataPath + r"\Dynamo\0.7\packages\Mantis Shrimp\extra"
rhPath = appDataPath + r"\Dynamo\0.7\packages\Mantis Shrimp\bin"
rhDllPath = appDataPath + r"\Dynamo\0.7\packages\Mantis Shrimp\bin\RhinoCommon.dll"
if msPath not in sys.path:
	sys.path.Add(msPath)
if rhPath not in sys.path:
	sys.path.Add(rhPath)
	clr.AddReferenceToFileAndPath(rhDllPath)

from Autodesk.DesignScript.Geometry import *
import Rhino as rc
from System import Array
from System.Collections.Generic import *

#The inputs to this node will be stored as a list in the IN variable.
dataEnteringNode = IN
rhObjects = IN[0]
_units = IN[1]

#unit conversion function from Rhino to DS
def toDSUnits(_units):
	if _units == rc.UnitSystem.Millimeters:
		return 0.001
	elif _units == rc.UnitSystem.Centimeters:
		return 0.01
	elif _units == rc.UnitSystem.Decimeters:
		return 0.1
	elif _units == rc.UnitSystem.Meters:
		return 1
	elif _units == rc.UnitSystem.Inches:
		return 0.0254
	elif _units == rc.UnitSystem.Feet:
		return 0.3048
	elif _units == rc.UnitSystem.Yards:
		return 0.9144

#Vector3d conversion function
def rhVector3dToVector(rhVector):
	VectorX = rhVector.X * toDSUnits(_units)
	VectorY = rhVector.Y * toDSUnits(_units)
	VectorZ = rhVector.Z * toDSUnits(_units)
	return Vector.ByCoordinates(VectorX, VectorY, VectorZ)

#3dPoint Conversion function
def rhPoint3dToPoint(rhPoint):
	rhPointX = rhPoint.X * toDSUnits(_units)
	rhPointY = rhPoint.Y * toDSUnits(_units)
	rhPointZ = rhPoint.Z * toDSUnits(_units)
	return Point.ByCoordinates(rhPointX, rhPointY, rhPointZ)

#point/control point conversion function
def rhPointToPoint(rhPoint):
	rhPointX = rhPoint.Location.X * toDSUnits(_units)
	rhPointY = rhPoint.Location.Y * toDSUnits(_units)
	rhPointZ = rhPoint.Location.Z * toDSUnits(_units)
	return Point.ByCoordinates(rhPointX, rhPointY, rhPointZ)
	
#Plane conversion function
def rhPlaneToPlane(rhPlane):
	normal = rhVector3dToVector(rhPlane.Normal)
	origin = rhPoint3dToPoint(rhPlane.Origin)
	return Plane.ByOriginNormal(origin, normal)

#LineCurve conversion function
def rhLineToLine(rhCurve):
	dsStartPoint = rhPoint3dToPoint(rhCurve.PointAtStart)
	dsEndPoint = rhPoint3dToPoint(rhCurve.PointAtEnd)
	return Line.ByStartPointEndPoint(dsStartPoint, dsEndPoint)

#arc conversion function
def rhArcToArc(rhArc):
	dsStartPoint = rhPoint3dToPoint(rhArc.Arc.StartPoint)
	dsEndPoint = rhPoint3dToPoint(rhArc.Arc.EndPoint)
	dsCenter = rhPoint3dToPoint(rhArc.Arc.Center)
	return Arc.ByCenterPointStartPointEndPoint(dsCenter, dsStartPoint, dsEndPoint)

#single span nurbs curve conversion function
def rhSingleSpanNurbsCurveToCurve(rhCurve):		
	#get control points
	ptArray, weights, knots = [], [], []
	rhControlPoints = rhCurve.Points
	for rhPoint in rhControlPoints:
		dsPoint = rhPointToPoint(rhPoint)
		ptArray.append(dsPoint)
		#get weights for each point
		weights.append(rhPoint.Weight)
	#convert Python list to IEnumerable[]
	ptArray = List[Point](ptArray)
	weights = Array[float](weights)
	#get degree of the curve
	degree = rhCurve.Degree
	#get knots of the curve
	rhKnots = rhCurve.Knots
	for i in rhKnots:
		knots.append(i)
	knots.insert(0, knots[0])
	knots.insert(len(knots), knots[(len(knots)-1)])
	knots = Array[float](knots)
	#create ds curve from points, weights and knots
	dsNurbsCurve = NurbsCurve.ByControlPointsWeightsKnots(ptArray, weights, knots, degree)
	ptArray.Clear()
	Array.Clear(weights, 0, len(weights))
	Array.Clear(knots, 0, len(knots))
	return dsNurbsCurve

#multi span nurbs curve comversion function
def rhMultiSpanNurbsCurveToCurve(rhCurve):
	dsNurbsCurve, rhSubCurve = [], []
	spanCount = rhCurve.SpanCount
	for i in range(0, spanCount, 1):
		rhCurveSubdomain = rhCurve.SpanDomain(i)
		rhSubCurve.append(rhCurve.ToNurbsCurve(rhCurveSubdomain))
	for curve in rhSubCurve:
		#get control points
		ptArray, weights, knots = [], [], []
		rhControlPoints = curve.Points
		for rhPoint in rhControlPoints:
			dsPoint = rhPointToPoint(rhPoint)
			ptArray.append(dsPoint)
			#get weights for each point
			weights.append(rhPoint.Weight)
		#convert Python list to IEnumerable[]
		ptArray = List[Point](ptArray)
		weights = Array[float](weights)
		#get degree of the curve
		degree = curve.Degree
		#get knots of the curve
		rhKnots = curve.Knots
		for i in rhKnots:
			knots.append(i)
		knots.insert(0, knots[0])
		knots.insert(len(knots), knots[(len(knots)-1)])
		knots = Array[float](knots)
		#create ds curve from points, weights and knots
		dsNurbsCurve.append(NurbsCurve.ByControlPointsWeightsKnots(ptArray, weights, knots, degree))
		ptArray.Clear()
		Array.Clear(weights, 0, len(weights))
		Array.Clear(knots, 0, len(knots))
	return dsNurbsCurve
	del dsNurbsCurve[:]

#poly curve conversion function
def rhCurveToPolyCurve(rhCurve):
	ptArray = []
	pCount = rhCurve.PointCount
	for i in range(0, pCount):
		dsPoint = rhPoint3dToPoint(rhCurve.Point(i))
		ptArray.append(dsPoint)
	dsPolyCurve = PolyCurve.ByPoints(ptArray)
	del ptArray[:]
	return dsPolyCurve

#rh polycurve conversion function
def rhPolyCurveToPolyCurve(rhCurve):
	dsSubCurves = []
	segmentCount = rhCurve.SegmentCount
	for i in range(0, segmentCount, 1):
		curve = rhCurve.SegmentCurve(i)
		if curve.ToString() == "Rhino.Geometry.LineCurve":
			dsSubCurves.append(rhLineToLine(curve))
		elif curve.ToString() == "Rhino.Geometry.PolylineCurve":
			dsSubCurves.append(rhCurveToPolyCurve(curve))
		elif curve.ToString() == "Rhino.Geometry.ArcCurve":
			dsSubCurves.append(rhArcToArc(curve))
		elif curve.ToString() == "Rhino.Geometry.NurbsCurve" and curve.SpanCount==1:
			dsSubCurves.append(rhSingleSpanNurbsCurveToCurve(curve))
		elif curve.ToString() == "Rhino.Geometry.NurbsCurve" and curve.SpanCount > 1:
			subPolyCurves = rhMultiSpanNurbsCurveToCurve(curve)
			for curve in subPolyCurves:
				dsSubCurves.append(curve)
		elif curve.ToString() == "Rhino.Geometry.PolyCurve":
			subPolyCurves = rhMultiSpanNurbsCurveToCurve(curve.ToNurbsCurve())
			for curve in subPolyCurves:
				dsSubCurves.append(curve)
	dsPolyCurve = PolyCurve.ByJoinedCurves(dsSubCurves)
	del dsSubCurves[:]
	return dsPolyCurve

#convert to DS poly curve
dsPolyCurves = []
for i in rhObjects:
	try:
		i = i.Geometry
	except:
		pass
	if i.ToString() == "Rhino.Geometry.PolyCurve":
		dsPolyCurves.append(rhPolyCurveToPolyCurve(i))

#Assign your output to the OUT variable
OUT = dsPolyCurves
# ----------------------------------------
Polycurve_s = Output(python_script)  # "Polycurve(s)"
