# Dynamo custom node RH Polyline to DS Polycurve.dyf (Dynamo 0.7.6.4145)
# category: Archi-lab_MantisShrimp.Rhinoceros.Geometry
# Converts Rhino polyline curve to Design Script polycurve.

Rhino_Object_s = Input()  # "Rhino Object(s)"
Units = Input()
python_script = Python(IN[0]=Rhino_Object_s, IN[1]=Units)
# ---------- python_script.python (76 lines) ----------
#Copyright(c) 2015, Konrad Sobon
# @arch_laboratory, http://archi-lab.net

import clr
import sys
clr.AddReference('ProtoGeometry')

pyt_path = r'C:\Program Files (x86)\IronPython 2.7\Lib'
sys.path.append(pyt_path)

import os
appDataPath = os.getenv('APPDATA')
msPath = appDataPath + r"\Dynamo\0.7\packages\Mantis Shrimp\extra"
rhPath = appDataPath + r"\Dynamo\0.7\packages\Mantis Shrimp\bin"
rhDllPath = appDataPath + r"\Dynamo\0.7\packages\Mantis Shrimp\bin\RhinoCommon.dll"
if msPath not in sys.path:
	sys.path.Add(msPath)
if rhPath not in sys.path:
	sys.path.Add(rhPath)
	clr.AddReferenceToFileAndPath(rhDllPath)

from Autodesk.DesignScript.Geometry import *
import Rhino as rc

#The inputs to this node will be stored as a list in the IN variable.
dataEnteringNode = IN
rhObjects = IN[0]
_units = IN[1]

#unit conversion function from Rhino to DS
def toDSUnits(_units):
	if _units == rc.UnitSystem.Millimeters:
		return 0.001
	elif _units == rc.UnitSystem.Centimeters:
		return 0.01
	elif _units == rc.UnitSystem.Decimeters:
		return 0.1
	elif _units == rc.UnitSystem.Meters:
		return 1
	elif _units == rc.UnitSystem.Inches:
		return 0.0254
	elif _units == rc.UnitSystem.Feet:
		return 0.3048
	elif _units == rc.UnitSystem.Yards:
		return 0.9144

#3dPoint Conversion function
def rhPoint3dToPoint(rhPoint):
	rhPointX = rhPoint.X * toDSUnits(_units)
	rhPointY = rhPoint.Y * toDSUnits(_units)
	rhPointZ = rhPoint.Z * toDSUnits(_units)
	return Point.ByCoordinates(rhPointX, rhPointY, rhPointZ)

#poly curve conversion function
def rhCurveToPolyCurve(rhCurve):
	ptArray = []
	pCount = rhCurve.PointCount
	for i in range(0, pCount):
		dsPoint = rhPoint3dToPoint(rhCurve.Point(i))
		ptArray.append(dsPoint)
	dsPolyCurve = PolyCurve.ByPoints(ptArray)
	del ptArray[:]
	return dsPolyCurve

#convert rhino/gh geometry to ds geometry
dsPolyCurves = []
for i in rhObjects:
	try:
		i = i.Geometry
	except:
		pass
	if i.ToString() == "Rhino.Geometry.PolylineCurve":
		dsPolyCurves.append(rhCurveToPolyCurve(i))

#Assign your output to the OUT variable
OUT = dsPolyCurves
# ----------------------------------------
PolyCurve_s = Output(python_script)  # "PolyCurve(s)"
