# Dynamo custom node Read GH File.dyf (Dynamo 0.7.6.4145)
# category: Archi-lab_MantisShrimp.Grasshopper.ReadGH
# Reads the file exported from Grasshopper (serializes it back into relevant Rhino geometry such as surfaces, points etc)

File_Path = Input()
Import = Input()
python_script = Python(IN[0]=File_Path, IN[1]=Import)
# ---------- python_script.python (98 lines) ----------
#Copyright(c) 2015, Konrad Sobon
# @arch_laboratory, http://archi-lab.net

import clr
import sys
clr.AddReference('ProtoGeometry')

pyt_path = r'C:\Program Files (x86)\IronPython 2.7\Lib'
sys.path.append(pyt_path)

import os
appDataPath = os.getenv('APPDATA')
msPath = appDataPath + r"\Dynamo\0.7\packages\Mantis Shrimp\extra"
rhPath = appDataPath + r"\Dynamo\0.7\packages\Mantis Shrimp\bin"
rhDllPath = appDataPath + r"\Dynamo\0.7\packages\Mantis Shrimp\bin\RhinoCommon.dll"
if msPath not in sys.path:
	sys.path.Add(msPath)
if rhPath not in sys.path:
	sys.path.Add(rhPath)
	clr.AddReferenceToFileAndPath(rhDllPath)

from Autodesk.DesignScript.Geometry import *
from System import Array
from System.Collections.Generic import *
import Rhino as rc
import pickle
from mantisshrimp import *

#The inputs to this node will be stored as a list in the IN variable.
dataEnteringNode = IN
filePath = str(IN[0])
_import = IN[1]

class SerializeObjects(object):
	def __init__(self, filePath, data = None):
		self.filePath = filePath
		self.data = data

	def saveToFile(self):
		with open(self.filePath, 'wb') as outf:
			pickle.dump(self.data, outf)

	def readFromFile(self):
		with open(self.filePath, 'rb') as inf:
			self.data = pickle.load(inf)

serializer = SerializeObjects(filePath)
serializer.readFromFile()

# recursive function to process any input list and output 
# matching structure list
def ProcessList(_func, _list, _units):
    return map( lambda x: ProcessList(_func, x, _units) if type(x)==list else _func(x, _units), _list )
    
# function to convert MS Objects to DS objects
def toDSObject(item, units):
	if type(item) == MSPoint:
		return item.toDSPoint(units)
	elif type(item) == MSLine:
		return item.toDSLine(units)
	elif type(item) == MSPolyLine:
		return item.toDSPolyCurve(units)
	elif type(item) == MSEllipse:
		return item.toDSEllipse(units)
	elif type(item) == MSCircle:
		return item.toDSCircle(units)
	elif type(item) == MSArc:
		return item.toDSArc(units)
	elif type(item) == MSNurbsCurve:
		return item.toDSNurbsCurve(units)
	elif type(item) == MSMultiSpanNurbsCurve:
		return item.toDSPolyCurve(units)
	elif type(item) == MSPolyCurve:
		return item.toDSPolyCurve(units)
	elif type(item) == MSMesh:
		return item.toDSMesh(units)
	elif type(item) == MSNurbsSurface:
		return item.toDSNurbsSurface(units)
	else:
		message = "Geometry type not yet supported"
		return message

message = None
if _import:
	serializedData = serializer.data
	if type(serializedData) == MSData:
		geometryOut = serializedData.data
	else:
		rhUnits = serializedData.pop(0).data
		geometryOut = ProcessList(toDSObject, serializedData, rhUnits)
else:
	message = "Import set to false"

#Assign your output to the OUT variable
if message == None:
	OUT = geometryOut
else:
	OUT = '\n'.join('{:^35}'.format(s) for s in message.split('\n'))
# ----------------------------------------
Rhino_Object_s = Output(python_script)  # "Rhino Object(s)"
