# Dynamo custom node Get Objects by Layer.dyf (Dynamo 0.7.2.24887)
# category: Archi-lab_MantisShrimp.ReadRhino
# Queries all Rhino objects on a given layer.

Rhino_File = Input()
Rhino_Layer = Input()
python_script = Python(IN[0]=Rhino_File, IN[1]=Rhino_Layer)
# ---------- python_script.python (25 lines) ----------
#Copyright(c) 2014, Konrad Sobon
# @arch_laboratory, http://archi-lab.net

import clr
import sys
clr.AddReference('ProtoGeometry')

RhinoCommonPath = r'C:\Program Files\Rhinoceros 5 (64-bit)\System'
if RhinoCommonPath not in sys.path:
	sys.path.Add(RhinoCommonPath)
clr.AddReferenceToFileAndPath(RhinoCommonPath + r"\RhinoCommon.dll")

pyt_path = r'C:\Program Files (x86)\IronPython 2.7\Lib'
sys.path.append(pyt_path)

import Rhino as rc

#The inputs to this node will be stored as a list in the IN variable.
dataEnteringNode = IN
rhModel = IN[0]
rhLayer = IN[1]

#get objects by layer
#Assign your output to the OUT variable
OUT = rhModel.Objects.FindByLayer(rhLayer)
# ----------------------------------------
Rhino_Object_s = Output(python_script)  # "Rhino Object(s)"
