# Dynamo custom node RH Nurbs Surface to DS Nurbs Surface.dyf (Dynamo 0.7.2.9146)
# category: Archi-lab_MantisShrimp.ReadRhino
# Converts Rhino nurbs surface to design script nurbs surface

Rhino_Object_s = Input()  # "Rhino Object(s)"
python_script = Python(IN[0]=Rhino_Object_s)
# ---------- python_script.python (91 lines) ----------
#Copyright(c) 2014, Konrad Sobon
# @arch_laboratory, http://archi-lab.net

import clr
import sys
clr.AddReference('ProtoGeometry')

RhinoCommonPath = r'C:\Program Files\Rhinoceros 5 (64-bit)\System'
if RhinoCommonPath not in sys.path:
	sys.path.Add(RhinoCommonPath)
clr.AddReferenceToFileAndPath(RhinoCommonPath + r"\RhinoCommon.dll")

pyt_path = r'C:\Program Files (x86)\IronPython 2.7\Lib'
sys.path.append(pyt_path)

from Autodesk.DesignScript.Geometry import *
from System import Array
from System.Collections.Generic import *
import Rhino as rc

#The inputs to this node will be stored as a list in the IN variable.
dataEnteringNode = IN
rhObjects = IN[0]

#point/control point conversion function
def rhPointToPoint(rhPoint):
	rhPointX = rhPoint.Location.X
	rhPointY = rhPoint.Location.Y
	rhPointZ = rhPoint.Location.Z
	dsPoint = Point.ByCoordinates(rhPointX, rhPointY, rhPointZ)
	return dsPoint

#brep/nurbs surface conversion function
def rhNurbsSurfaceToSurface(rhNurbsSurface):
	dsNurbsSurfaces = []
	dsControlPoints = []
	dsWeights = []
	#get control points and weights
	rhControlPoints = rhNurbsSurface.Points
	for point in rhControlPoints:
		dsControlPoints.append(rhPointToPoint(point))
		dsWeights.append(point.Weight)
	#get knotsU and knotsV
	rhKnotsU = rhNurbsSurface.KnotsU
	dsKnotsU = []
	for i in rhKnotsU:
		dsKnotsU.append(i)
	dsKnotsU.insert(0, dsKnotsU[0])
	dsKnotsU.insert(len(dsKnotsU), dsKnotsU[len(dsKnotsU)-1])
	dsKnotsU = Array[float](dsKnotsU)
	rhKnotsV = rhNurbsSurface.KnotsV
	dsKnotsV = []
	for i in rhKnotsV:
		dsKnotsV.append(i)
	dsKnotsV.insert(0, dsKnotsV[0])
	dsKnotsV.insert(len(dsKnotsV), dsKnotsV[len(dsKnotsV)-1])
	dsKnotsV = Array[float](dsKnotsV)
	#get uDegree and vDegree via order-1
	dsDegreeU = (rhNurbsSurface.OrderU) - 1 
	dsDegreeV = (rhNurbsSurface.OrderV) - 1
	#compute number of UV Control points
	uCount = rhNurbsSurface.SpanCount(0) + 3
	vCount = rhNurbsSurface.SpanCount(1) + 3
	#split control points into sublists of UV points
	#convert list of lists to Array[Array[point]]
	newControlPoints = [dsControlPoints[i:i+vCount] for i  in range(0, len(dsControlPoints), vCount)]
	newWeights = [dsWeights[i:i+vCount] for i  in range(0, len(dsWeights), vCount)]

	weightsArrayArray = Array[Array[float]](map(tuple, newWeights))
	controlPointsArrayArray = Array[Array[Point]](map(tuple, newControlPoints))
	#create ds nurbs surface
	dsNurbsSurface = NurbsSurface.ByControlPointsWeightsKnots(controlPointsArrayArray, weightsArrayArray, dsKnotsU, dsKnotsV, dsDegreeU, dsDegreeV)
	return dsNurbsSurface

#convert nurbs surfaces to ds nurbs surfaces
dsNurbsSurfaces = []
for i in rhObjects:
	try:
		i = i.Geometry
	except:
		pass	
	if i.ToString() == "Rhino.Geometry.Brep":
		brepFaces = i.Faces
		n = brepFaces.Count
		for i in range(0, n, 1):
			rhSurface = brepFaces.Item[i].UnderlyingSurface()
			if rhSurface.ToString() == "Rhino.Geometry.NurbsSurface":
				dsNurbsSurfaces.append(rhNurbsSurfaceToSurface(rhSurface))
			
#Assign your output to the OUT variable
OUT = dsNurbsSurfaces
# ----------------------------------------
Nurbs_Surface_s = Output(python_script)  # "Nurbs Surface(s)"
