# Dynamo custom node Read GH File.dyf (Dynamo 0.7.2.9146)
# category: Archi-lab_MantisShrimp.ReadGrasshopper
# Reads the file exported from Grasshopper (serializes it back into relevant Rhino geometry such as surfaces, points etc)

File_Path = Input()
python_script = Python(IN[0]=File_Path)
# ---------- python_script.python (44 lines) ----------
#Copyright(c) 2014, Konrad Sobon
# @arch_laboratory, http://archi-lab.net

import clr
import sys
clr.AddReference('ProtoGeometry')

RhinoCommonPath = r'C:\Program Files\Rhinoceros 5 (64-bit)\System'
if RhinoCommonPath not in sys.path:
	sys.path.Add(RhinoCommonPath)
clr.AddReferenceToFileAndPath(RhinoCommonPath + r"\RhinoCommon.dll")

pyt_path = r'C:\Program Files (x86)\IronPython 2.7\Lib'
sys.path.append(pyt_path)

from Autodesk.DesignScript.Geometry import *
from System import Array
from System.Collections.Generic import *
import Rhino as rc
import pickle


#The inputs to this node will be stored as a list in the IN variable.
dataEnteringNode = IN
filePath = str(IN[0])

class SerializeObjects(object):
	def __init__(self, filePath, data = None):
		self.filePath = filePath
		self.data = data

	def saveToFile(self):
		with open(self.filePath, 'wb') as outf:
			pickle.dump(self.data, outf)

	def readFromFile(self):
		with open(self.filePath, 'rb') as inf:
			self.data = pickle.load(inf)

serializer = SerializeObjects(filePath)
serializer.readFromFile()

#Assign your output to the OUT variable
OUT = serializer.data
# ----------------------------------------
Rhino_Object_s = Output(python_script)  # "Rhino Object(s)"
